# Grasshopper definition hysteresis-remote.ghx (Grasshopper 0.9.76)
# plug-ins: Python Interpreter, Flux

flux = FluxProject(project="a9jAyvE70YL3qR5WZ")  # -> Keys, Meta
flow_control = FlowControl({"Once", "Constantly"}, selected="Constantly")
from_flux = FromFlux(
    Keys=flux.Keys,
    Mode=flow_control,
    keyId="40125174d928b38689aec28fc8e6e8ed",
    mode="Constantly",
    Branch0_Path="{0}",
    Branch0_Item0_null_string=False,
    Branch0_Item0_string="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",
    Branch0_Item0_TypeName="Grasshopper.Kernel.Types.GH_String")  # -> Value, Meta
to_flux = ToFlux(Keys=flux.Keys, Mode=flow_control, keyId="40cb7ce2f54c0b988a90e04600d8d638", mode="Constantly")  # disabled
placexmlsnippet = CSharpScript(x=from_flux.Value)  # -> out, A; inputs x: String
# ---------- placexmlsnippet: C# ----------
    string xmlSnippet = x;
    ClearCanvas();
    System.Windows.Forms.Clipboard.SetText(xmlSnippet);
    Paste();
# ---------- placexmlsnippet: C# additional code ----------
  void ClearCanvas(){
    GH_DocumentIO docIO = new GH_DocumentIO(GrasshopperDocument);
    List<IGH_DocumentObject> objectsToKeep = new List<IGH_DocumentObject>();
    List<IGH_DocumentObject> objectsToClear = new List<IGH_DocumentObject>();
    Grasshopper.Kernel.Special.GH_Group grp = new Grasshopper.Kernel.Special.GH_Group();

    foreach(IGH_DocumentObject obj in GrasshopperDocument.Objects){ //for all objs in GH doc

      if(obj is Grasshopper.Kernel.Special.GH_Group){ //if it's a group
        grp = obj as Grasshopper.Kernel.Special.GH_Group;
        //if the group contains this script, add those objects to the objectsToKeep list
        if(grp.Objects().Exists(x => x.InstanceGuid == this.Component.InstanceGuid)){
          objectsToKeep.Add(obj);
          foreach(IGH_DocumentObject grpObj in grp.Objects()){ // for all the objects in the group
            objectsToKeep.Add(grpObj);
          }
        }
      }
      //start objectsToClear list with all objects
      objectsToClear = GrasshopperDocument.Objects.ToList();
    }
    //remove objectsToKeep from objectsToClear
    foreach(IGH_DocumentObject obj in objectsToKeep){
      objectsToClear.Remove(obj);
    }
    //delete remaining items
    foreach(IGH_DocumentObject obj in objectsToClear){
      GrasshopperDocument.Objects.Remove(obj);
    }

  } 
  
  void Paste(){
    GH_DocumentIO documentIO = new GH_DocumentIO();
    documentIO.Paste(GH_ClipboardType.System);
    var thispivot = this.Component.Attributes.Pivot;

    int smallestX = Int32.MaxValue;
    int smallestY = Int32.MaxValue;
    foreach(IGH_DocumentObject obj in documentIO.Document.Objects){
      var pivot = obj.Attributes.Pivot;
      if(pivot.X < smallestX) smallestX = (int) pivot.X;
      if(pivot.Y < smallestY) smallestY = (int) pivot.Y;
    }

    System.Drawing.Size offset = new System.Drawing.Size((int) thispivot.X - smallestX, (int) thispivot.Y - smallestY);

    documentIO.Document.TranslateObjects(offset, false);
    documentIO.Document.SelectAll();
    documentIO.Document.ExpireSolution();
    documentIO.Document.MutateAllIds();
    System.Collections.Generic.IEnumerable<IGH_DocumentObject> objs = documentIO.Document.Objects;
    GrasshopperDocument.DeselectAll();
    GrasshopperDocument.MergeDocument(documentIO.Document);
    GrasshopperDocument.UndoUtil.RecordAddObjectEvent("Paste", objs);
    //  documentIO.ClearClipboard(GH_ClipboardType.System);
    GrasshopperDocument.ScheduleSolution(10);
    List<IGH_DocumentObject> myDisabledObj = new List<IGH_DocumentObject>();
    myDisabledObj = GrasshopperDocument.DisabledObjects();

  }
# ---------- end placexmlsnippet ----------
from_flux_2 = FromFlux(
    Keys=flux.Keys,
    Mode=flow_control,
    keyId="4082566f6a4c3b9b7b26701fdb4b1c3b",
    mode="Constantly",
    Branch0_Path="{0}",
    Branch0_Item0_null_string=False,
    Branch0_Item0_string="""VDoguscan
p0
.""",
    Branch0_Item0_TypeName="Grasshopper.Kernel.Types.GH_String")  # -> Value, Meta
from_flux_3 = FromFlux(
    Keys=flux.Keys,
    Mode=flow_control,
    keyId="404722a83a22684e0079a179785efa64",
    mode="Constantly",
    Branch0_Path="{0;0;0}",
    Branch0_Item0_null_string=False,
    Branch0_Item0_string="""(lp0
F7.0
a.""",
    Branch0_Item0_TypeName="Grasshopper.Kernel.Types.GH_String",
    Branch0_Item1_null_string=False,
    Branch0_Item1_string="""(lp0
F5.0
a.""",
    Branch0_Item1_TypeName="Grasshopper.Kernel.Types.GH_String",
    Branch0_Item2_null_string=False,
    Branch0_Item2_string="""(lp0
F3.0
a.""",
    Branch0_Item2_TypeName="Grasshopper.Kernel.Types.GH_String",
    Branch0_Item3_null_string=False,
    Branch0_Item3_string="""(lp0
F7.0
a.""",
    Branch0_Item3_TypeName="Grasshopper.Kernel.Types.GH_String",
    Branch0_Item4_null_string=False,
    Branch0_Item4_string="""(lp0
F2.0
a.""",
    Branch0_Item4_TypeName="Grasshopper.Kernel.Types.GH_String",
    Branch0_Item5_null_string=False,
    Branch0_Item5_string="""(lp0
F0.0
a.""",
    Branch0_Item5_TypeName="Grasshopper.Kernel.Types.GH_String",
    Branch0_Item6_null_string=False,
    Branch0_Item6_string="""(lp0
F13.0
a.""",
    Branch0_Item6_TypeName="Grasshopper.Kernel.Types.GH_String",
    Branch0_Item7_null_string=False,
    Branch0_Item7_string="""(lp0
F4.0
a.""",
    Branch0_Item7_TypeName="Grasshopper.Kernel.Types.GH_String",
    Branch0_Item8_null_string=False,
    Branch0_Item8_string="""(lp0
F0.0
a.""",
    Branch0_Item8_TypeName="Grasshopper.Kernel.Types.GH_String",
    Branch0_Item9_null_string=False,
    Branch0_Item9_string="""(lp0
F17.0
a.""",
    Branch0_Item9_TypeName="Grasshopper.Kernel.Types.GH_String",
    Branch0_Item10_null_string=False,
    Branch0_Item10_string="""(lp0
F5.0
a.""",
    Branch0_Item10_TypeName="Grasshopper.Kernel.Types.GH_String",
    Branch0_Item11_null_string=False,
    Branch0_Item11_string="""(lp0
F20.0
a.""",
    Branch0_Item11_TypeName="Grasshopper.Kernel.Types.GH_String")  # -> Value, Meta
from_flux_4 = FromFlux(
    Keys=flux.Keys,
    Mode=flow_control,
    keyId="40fc6dc0a9c8f0442f6624b91b6640f1",
    mode="Constantly",
    Branch0_Path="{0;0;0}",
    Branch0_Item0_null_string=False,
    Branch0_Item0_string="N.",
    Branch0_Item0_TypeName="Grasshopper.Kernel.Types.GH_String")  # -> Value, Meta
from_flux_5 = FromFlux(
    Keys=flux.Keys,
    Mode=flow_control,
    keyId="40b8bce9d56129e52fe444d295fc9af4",
    mode="Constantly",
    Branch0_Path="{0;0}",
    Branch0_Item0_number=217,
    Branch0_Item0_TypeName="Grasshopper.Kernel.Types.GH_Integer")  # -> Value, Meta
deserialize = PythonScript(input=from_flux_3.Value)  # -> output
# ---------- deserialize: Python ----------
import cPickle
output = cPickle.loads(input)
print output
print(type(output))
# ---------- end deserialize ----------
deserialize_2 = PythonScript(input=from_flux_4.Value)  # -> output; same code as deserialize
deserialize_3 = PythonScript(input=from_flux_2.Value)  # -> output; same code as deserialize
tree2list = PythonScript(intree=deserialize)  # -> outlist; inputs intree: tree
# ---------- tree2list: Python ----------
myList=[]
for i in range(intree.BranchCount):
    arr1 = []
    for j in range(len(intree.Branch(i))):
        arr1.append(intree.Branch(i)[j])
    myList.append(arr1)
    
outlist = myList
print outlist
# ---------- end tree2list ----------
cartesianproduct = PythonScript(kernel=tree2list)  # -> cproduct; inputs kernel: list
# ---------- cartesianproduct: Python ----------
import itertools
import cPickle

def generate_cproduct(matrix):
    #cartesian product
    product = []
    for item in itertools.product(*matrix):
        product.append(item)
    return product

cproduct = generate_cproduct(kernel)
print kernel
# ---------- end cartesianproduct ----------
panel = Panel(deserialize_3)
getdirectory = PythonScript()  # -> dir, file_name, full_path
# ---------- getdirectory: Python ----------
import os
fn = ghenv.Component.OnPingDocument()
file_name = (str(fn)).strip("*")
print file_name

full_path = (ghenv.Component.OnPingDocument().FilePath)

dir = full_path.replace(file_name+".ghx","")
print dir
print full_path
# ---------- end getdirectory ----------
panel_2 = Panel("MyCluster")
c_script = CSharpScript(Cluster=deserialize_3, Output="R")  # -> out, Data; inputs Cluster: String, Output: String
# ---------- c_script: C# ----------
    RegisterSolutionStartEvent();

    IGH_Param parameter = FindParameter(Cluster, Output);
    if (parameter == null)
    {
      Print("No such cluster+parameter could be found");
      return;
    }

    Data = HarvestData(parameter);
# ---------- c_script: C# additional code ----------
  private bool _registered = false;

  private void RegisterSolutionStartEvent()
  {
    if (_registered)
      return;

    _registered = true;
    GrasshopperDocument.SolutionStart += Document_SolutionStart;
  }

  private void Document_SolutionStart(object sender, EventArgs e)
  {
    // TODO: figure out whether the cluster we're supposed to be watching
    //       has expired. If so, then we need to expire this component as well.
    
    Component.ExpireSolution(false);
  }
  private IGH_Param FindParameter(string clusterName, string outputName)
  {
    // Iterate over all objects in the document.
    foreach (IGH_DocumentObject obj in GrasshopperDocument.Objects)
    {
      // Make sure nickname matches.
      if (!string.Equals(clusterName, obj.NickName, StringComparison.Ordinal))
        continue;

      // Make sure object is a cluster.
      Grasshopper.Kernel.Special.GH_Cluster cluster = obj as Grasshopper.Kernel.Special.GH_Cluster;
      if (obj == null)
        continue;

      // Iterate over all output parameters.
      foreach (IGH_Param output in cluster.Params.Output)
        if (string.Equals(output.NickName, outputName, StringComparison.Ordinal))
          return output;
    }

    return null;
  }
  private DataTree<object> HarvestData(IGH_Param parameter)
  {
    // Make sure the cluster has been solved.
    Grasshopper.Kernel.Special.GH_Cluster cluster =
      parameter.Attributes.Parent.DocObject as Grasshopper.Kernel.Special.GH_Cluster;
    if (cluster == null)
      return null;

    if (cluster.Phase != GH_SolutionPhase.Computed)
    {
      cluster.CollectData();
      cluster.ComputeData();
    }

    IGH_Structure tree = parameter.VolatileData;
    if (tree == null)
    {
      Print("Parameter contains no data.");
      return null;
    }

    DataTree<object> newTree = new DataTree<object>();
    newTree.MergeStructure(tree, null);
    return newTree;
  }
# ---------- end c_script ----------
c_script_2 = CSharpScript(Cluster=deserialize_3, Output="R")  # -> out, Data; inputs Cluster: String, Output: String; disabled
# ---------- c_script_2: C# ----------
    IGH_Structure tree = null;

    // Iterate over all objects in the document.
    foreach (IGH_DocumentObject obj in GrasshopperDocument.Objects)
    {
      // Make sure nickname matches.
      if (!string.Equals(Cluster, obj.NickName, StringComparison.Ordinal))
        continue;

      // Make sure object is a cluster.
      Grasshopper.Kernel.Special.GH_Cluster cluster = obj as Grasshopper.Kernel.Special.GH_Cluster;
      if (obj == null)
        continue;

      // Make sure the cluster has been solved.
      if (cluster.Phase != GH_SolutionPhase.Computed)
      {
        cluster.CollectData();
        cluster.ComputeData();
      }

      // Iterate over all output parameters.
      foreach (IGH_Param output in cluster.Params.Output)
        if (string.Equals(output.NickName, Output, StringComparison.Ordinal))
        {
          tree = output.VolatileData;
          break;
        }

      if (tree != null)
        break;
    }

    if (tree == null)
    {
      Print("No matching cluster could be found");
      return;
    }

    DataTree<object> newTree = new DataTree<object>();
    newTree.MergeStructure(tree, null);

    Data = newTree;
# ---------- end c_script_2 ----------
from_flux_6 = FromFlux(
    Keys=flux.Keys,
    Mode=flow_control,
    keyId="4006faa082ee097903a6e99e6db4516a",
    mode="Constantly",
    Branch0_Path="{0}",
    Branch0_Item0_null_string=False,
    Branch0_Item0_string="recorded",
    Branch0_Item0_TypeName="Grasshopper.Kernel.Types.GH_String")  # -> Value, Meta
selector = PythonScript(input=cartesianproduct, keys=deserialize_2, index=from_flux_5.Value, node_name=deserialize_3, mode=from_flux_6.Value)  # -> out, node, alt; inputs input: list, keys: list
# ---------- selector: Python ----------
import cPickle
def get_alt(index, productlist,keys):
    i = int(index)%(len(productlist)) 
    selection = productlist[i]    
    rvec = dict()    
    nkeylist = []
    for key in keys:
        nkeylist.append(key)
    for key,value in zip(nkeylist,selection):
        rvec[key] = value
    return rvec

def update_model(rvec, node):
    for input in node.Params.Input:
        value = rvec[input.NickName]
        input.Sources[0].Slider.Value = value
    node.ExpireSolution(True)
    print "Updated "+node.NickName
    
def get_node(name):
    ghObjects = ghenv.Component.OnPingDocument().Objects
    for obj in ghObjects:
        if obj.NickName == name:
            return obj
    print "Node not found"
    
node = get_node(node_name)
_alt = get_alt(index, input, keys)
if mode == "recorded":
    update_model(_alt, node)
    alt = cPickle.dumps(_alt)
    print _alt
    print alt
# ---------- end selector ----------
grabnodeoutput = PythonScript(node=selector.node)  # -> result; disabled
# ---------- grabnodeoutput: Python ----------
print node.NickName
outputList = []
#for output in node.Params.Output:
#    outputList.append(output)
    
#result = outputList
#meh
result = node.Params.Output[0]
print result
#print outputList
# ---------- end grabnodeoutput ----------
to_flux_2 = ToFlux(Keys=flux.Keys, Value=c_script.Data, Mode=flow_control, keyId="40eb4de7d220ebd98aef0ffb841f45d5", mode="Constantly")
from_flux_7 = FromFlux(
    Keys=flux.Keys,
    Mode=flow_control,
    keyId="403b08d4ea68137ba11c4286c4962062",
    mode="Constantly",
    Branch0_Path="{0}",
    Branch0_Item0_null_string=False,
    Branch0_Item0_string="""V{"param05":[9,10,10],"param10":[20,20,20],"param11":[3,3,3],"param08":[5,5,5],"param09":[0,0,0],"param02":[6,6,6],"param03":[17,20,20],"param01":[16,16,16],"param06":[0,6,6],"param07":[7,7,7],"param04":[5,5,5]}
p0
.""",
    Branch0_Item0_TypeName="Grasshopper.Kernel.Types.GH_String")  # -> Value, Meta
deserialize_4 = PythonScript(input=from_flux_7.Value)  # -> output; same code as deserialize
tree2list_2 = PythonScript()  # -> out, outlist; inputs intree: tree
# ---------- tree2list_2: Python ----------
outlist = []
for i in range(intree.BranchCount):
    print intree.Branch(i)
    outlist.append(intree.Branch(i))
# ---------- end tree2list_2 ----------
kernel2product = PythonScript(
    data=deserialize_4,
    node_name=panel,
    dir=getdirectory.dir,
    full_path=getdirectory.full_path,
    index=from_flux_5.Value,
    mode=from_flux_6.Value)  # -> alt
# ---------- kernel2product: Python ----------
import json
import itertools
import Grasshopper as gh
from System import Guid
from scriptcontext import doc
import os
import time
import Rhino
import rhinoscriptsyntax as rs
import cPickle

gh = Rhino.RhinoApp.GetPlugInObject("Grasshopper")

#rs.EnableRedraw(True)

pardir = os.path.abspath(os.path.join(dir, os.pardir))
path = os.path.join(pardir,"gallery"+os.sep)
print path
pardir2 = os.path.abspath(os.path.join(path, os.pardir))
path_kernel = os.path.join(pardir2, "received"+os.path.sep)
print path_kernel
keylist = []
valuelist = []

def create_flipdict(data):
    veclist = []
    # turn strings into dicts
    for item in data:
        vec = eval(item)
        veclist.append(vec)
    
    flipdict = dict()    
    # get the names of keys to iterate over 
    for vec in veclist:   
        for key in vec:
            flipdict[key] = []
    
    #accumulate
    for key in flipdict:
        for vec in veclist:
            if key in vec:
                flipdict[key].append(vec[key])
    return flipdict                

def create_matrix(flipdict):
        
    #create matrix 
    matrix = []       
    for key in flipdict:
        matrix.append(set(flipdict[key]))
    return matrix

def generate_cproduct(matrix):
    #cartesian product
    product = []
    for item in itertools.product(*matrix):
        product.append(item)
    return product

def get_alt(index, productlist,flipdict):
    i = int(index)%(len(productlist)) 
    selection = productlist[i]    
    rvec = dict()    
    nkeylist = []
    for key in flipdict:
        nkeylist.append(key)
    for key,value in zip(nkeylist,selection):
        rvec[key] = value
    return rvec

def update_model(rvec, node):
    for input in node.Params.Input:
        value = rvec[input.NickName]
        input.Sources[0].Slider.Value = value
    node.ExpireSolution(False)
    print "Updated "+node.NickName
    
def get_node(name):
    ghObjects = ghenv.Component.OnPingDocument().Objects
    for obj in ghObjects:
        if obj.NickName == name:
            return obj
    print "Node not found"
def captureView(uid):
    bmp = view.CaptureToBitmap(False, False, False)
    bmp.Save(path+uid+".bmp")       

def send_to_gallery(data,send):
    if send:
        json_data = dict()
    
        uid = str(Guid.NewGuid())
        json_data['params'] = data
        json_data['uid'] = uid
        json_data['cad_file'] = 'xyz.obj'
        json_data['image'] = uid+'.bmp'
        captureView(uid)
#        bitmap = doc.Views.ActiveView.CaptureToBitmap(True, True, True)
#        bitmap.Save(path+uid+'.bmp')
        with open(path+uid+'.json','w') as outfile:
            json.dump(json_data, outfile, indent=2)
        print "Sent "+uid+" to gallery"       





# Generate cart. prod. from new kernel and slowly send to gallery
node = get_node(node_name)
# Read file
if os.path.exists(path_kernel+'kernel.json'):
    f = open(path_kernel+'kernel.json','r')
    data = f.read()
    f.close()
    if len(data)>0:
        # parse the data into dict
        kernel = json.loads(data)
        #erase the file contents to prevent infinite loop
#       f = open(path_kernel+'kernel.json','w')
#       f.write('')
#       f.close()
            
        _matrix = create_matrix(kernel)
        _cproduct = generate_cproduct(_matrix)
#            
#            #now iterate over _cproduct and update model
#            #then wait for 1 sec and take snapshot, send to gall
#        for i in range(8,40,1):
        if mode == "gallery":
            _alt = get_alt(index , _cproduct, kernel)
            update_model(_alt,node)
            alt = cPickle.dumps(_alt)
            print alt
        else:
            alt = None
            print alt
#            time.sleep(0.5)
#            gh.RunSolver(full_path)
#            time.sleep(1)
#            send_to_gallery(_alt, True)
# ---------- end kernel2product ----------
nonnull = PythonScript(input0=selector.alt, input1=kernel2product)  # -> a; inputs input1: tree
# ---------- nonnull: Python ----------
if not input0 == None:
    a = input0
else:
    a = input1
    
print a
# ---------- end nonnull ----------
to_flux_3 = ToFlux(Keys=flux.Keys, Value=nonnull, Mode=flow_control, keyId="408642bb36ad94d34f040012d21f4c92", mode="Constantly")

flux_2 = FluxProject(project="a9jAyvE70YL3qR5WZ")  # -> Keys, Meta
to_flux_4 = ToFlux(Keys=flux_2.Keys, keyId="40eb4de7d220ebd98aef0ffb841f45d5", mode="Constantly")
