# Grasshopper definition hysteresis2.0.ghx (Grasshopper 0.9.76)
# plug-ins: Python Interpreter, Flux

outputshape_seg = Slider(3, range=3..8)
gridtype = Slider(3, range=0..4)
pointy = Slider(0.6, range=0..1)
attf_x = Slider(0, range=0..2)
scale = Slider(1, range=1..15)
outputshape = Slider(0, range=0..1)
pointx = Slider(0.8, range=0..1)
angle = Slider(0, range=0..100)
flux = FluxProject(project="a9jAyvE70YL3qR5WZ")  # -> Keys, Meta
reactorgen = ReactorGen(G=gridtype, G_2=attf_x, G_3=outputshape, S=outputshape_seg, A=pointx, A_2=pointy, B=scale, A_3=angle)
flow_control = FlowControl({"Once", "Constantly"}, selected="Constantly")
to_flux = ToFlux(Keys=flux.Keys, Mode=flow_control, keyId="40eb4de7d220ebd98aef0ffb841f45d5", mode="Constantly")
createsnippet = CreateSnippet(run=Button(ExpressionNormal="True", ExpressionPressed="False"))  # -> out, A; inputs run: Boolean
# ---------- createsnippet: C# ----------
    if(!run) return;
    GH_DocumentIO docIO = new GH_DocumentIO(GrasshopperDocument);
    List<Guid> objectsToCopy = new List<Guid>();
    foreach(IGH_DocumentObject obj in GrasshopperDocument.Objects){ //for all objs in GH doc
      if(obj is Grasshopper.Kernel.Special.GH_Group){ //if it's a group
        Grasshopper.Kernel.Special.GH_Group grp = obj as Grasshopper.Kernel.Special.GH_Group;
        if(grp.Objects().Exists(x => x.InstanceGuid == this.Component.InstanceGuid)){ //if the group contains this script
          foreach(IGH_DocumentObject grpObj in grp.Objects()){ // for all the objects in the group
            if(grpObj.InstanceGuid != this.Component.InstanceGuid){ // if the object isn't this component
              //save the guid of the objects to copy
              objectsToCopy.Add(grpObj.InstanceGuid);
            }
          }
        }

      }
    }

    //create a binary representation of the objects from the group by copying them and serializing the XML from the clipboard
    docIO.Copy(GH_ClipboardType.System, objectsToCopy);
    string snippet = System.Windows.Forms.Clipboard.GetText();
    docIO.ClearClipboard(GH_ClipboardType.System);

    string locked = "<item name=\"Locked\" type_name=\"gh_bool\" type_code=\"1\">true</item>";
    string unlocked = "<item name=\"Locked\" type_name=\"gh_bool\" type_code=\"1\">false</item>";
    // string locked = @"" < item name = "Locked" type_name = "gh_bool" type_code = "1" > true</item > "";
    // string unlocked = @"" < item name = "Locked" type_name = "gh_bool" type_code = "1" > false</item > "";

    snippet = snippet.Replace(locked, unlocked);
    A = snippet;
# ---------- end createsnippet ----------

geo = Geometry(reactorgen)

index = ControlKnob(Decimals=0, Limit=False, Maximum=10, Minimum=0, Range=10, Value=64)
record = Button()
reset = Button()

flux_2 = FluxProject(project="a9jAyvE70YL3qR5WZ")  # -> Keys, Meta
flow_control_2 = FlowControl({"Once", "Constantly"}, selected="Constantly")
from_flux = FromFlux(
    Keys=flux_2.Keys,
    Mode=flow_control_2,
    keyId="40eb4de7d220ebd98aef0ffb841f45d5",
    mode="Constantly",
    Branch0_Path="{0;0;0}",
    Branch0_Item0_EdgeIndex=-1,
    Branch0_Item0_TypeName="Grasshopper.Kernel.Types.GH_Curve",
    Branch0_Item1_EdgeIndex=-1,
    Branch0_Item1_TypeName="Grasshopper.Kernel.Types.GH_Curve",
    Branch0_Item2_EdgeIndex=-1,
    Branch0_Item2_TypeName="Grasshopper.Kernel.Types.GH_Curve",
    Branch0_Item3_EdgeIndex=-1,
    Branch0_Item3_TypeName="Grasshopper.Kernel.Types.GH_Curve",
    Branch0_Item4_EdgeIndex=-1,
    Branch0_Item4_TypeName="Grasshopper.Kernel.Types.GH_Curve",
    Branch0_Item5_EdgeIndex=-1,
    Branch0_Item5_TypeName="Grasshopper.Kernel.Types.GH_Curve",
    Branch0_Item6_EdgeIndex=-1,
    Branch0_Item6_TypeName="Grasshopper.Kernel.Types.GH_Curve",
    Branch0_Item7_EdgeIndex=-1,
    Branch0_Item7_TypeName="Grasshopper.Kernel.Types.GH_Curve",
    Branch1_Path="{0;0;1}",
    Branch1_Item0_EdgeIndex=-1,
    Branch1_Item0_TypeName="Grasshopper.Kernel.Types.GH_Curve",
    Branch1_Item1_EdgeIndex=-1,
    Branch1_Item1_TypeName="Grasshopper.Kernel.Types.GH_Curve",
    Branch1_Item2_EdgeIndex=-1,
    Branch1_Item2_TypeName="Grasshopper.Kernel.Types.GH_Curve",
    Branch1_Item3_EdgeIndex=-1,
    Branch1_Item3_TypeName="Grasshopper.Kernel.Types.GH_Curve",
    Branch1_Item4_EdgeIndex=-1,
    Branch1_Item4_TypeName="Grasshopper.Kernel.Types.GH_Curve"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)  # -> Value, Meta
flux_3 = FluxProject(project="a9jAyvE70YL3qR5WZ")  # -> Keys, Meta
move = Move(Geometry=from_flux.Value, Motion=Vector(166, 0, 0))  # -> Geometry, Transform
to_flux_2 = ToFlux(
    Keys=flux_3.Keys,
    Value=createsnippet.A,
    Mode=flow_control_2,
    keyId="40125174d928b38689aec28fc8e6e8ed",
    mode="Constantly")

send_to_gallery = Button()
new_product = Button()

getdirectory = PythonScript()  # -> dir, file_name, full_path
# ---------- getdirectory: Python ----------
import os
fn = ghenv.Component.OnPingDocument()
file_name = (str(fn)).strip("*")
print file_name

full_path = (ghenv.Component.OnPingDocument().FilePath)

dir = full_path.replace(file_name+".ghx","")
print dir
print full_path
# ---------- end getdirectory ----------
datafile = PythonScript(path=getdirectory.dir)  # -> datafile
# ---------- datafile: Python ----------
import os
datafile = os.path.join(path, "data.dat")
print datafile
# ---------- end datafile ----------
restorefile = PythonScript(path=getdirectory.dir)  # -> restorefile
# ---------- restorefile: Python ----------
import os

pardir = os.path.abspath(os.path.join(path, os.pardir))

restorefile = os.path.join(pardir, "received"+os.path.sep+"restore.json")
print path
print pardir
print restorefile
# ---------- end restorefile ----------
file = ReadFile(File=restorefile, PerLineParse=False)
file_2 = ReadFile(F=datafile, PerLineParse=True)  # -> C
#   port F: Uri of file to read
# ---------- file_2: VB line parser ----------
    action = GH_LineParserAction.Include
    Return line

    'Parse the line and return some data that represents the line.
    'If the line cannot be parsed, you can return Nothing and
    'assign a different action.
    'The default implementation is to just return the line itself.
    'If you return types that implement IGH_Goo, this component
    'will work substantially faster.
# ---------- end file_2 ----------
restore_state = PythonScript(file=file, node_name="ReactorGen")
# ---------- restore_state: Python ----------
import json
state = json.loads(file)

ghObjects = ghenv.Component.OnPingDocument().Objects
for obj in ghObjects:
    if obj.NickName == node_name:
        for input in obj.Params.Input:
            value = state['params'][input.NickName]
            input.Sources[0].Slider.Value = value
        obj.ExpireSolution(True)
# ---------- end restore_state ----------
magicbox = PythonScript(node_name="ReactorGen", data=simplify(file_2), index=index)  # -> matrix, keys, index, alt; inputs data: list
# ---------- magicbox: Python ----------
import json
import cPickle
import itertools
import Grasshopper as gh
from System import Guid
from scriptcontext import doc
import os
import time

keylist = []
valuelist = []

#def chunks(l, n):
#    """Yield successive n-sized chunks from l."""
#    for i in xrange(0, len(l), n):
#        yield l[i:i+n]
#        
#def get_node(name):
#    ghObjects = ghenv.Component.OnPingDocument().Objects
#    for obj in ghObjects:
#        if obj.NickName == name:
#            return obj
#    print "Node not found"

def create_flipdict(data):
    veclist = []
    # turn strings into dicts
    for item in data:
        vec = eval(item)
        veclist.append(vec)
    
    flipdict = dict()    
    # get the names of keys to iterate over 
    for vec in veclist:   
        for key in vec:
            flipdict[key] = []
    
    #accumulate
    for key in flipdict:
        for vec in veclist:
            if key in vec:
                flipdict[key].append(vec[key])
    return flipdict                

def create_matrix(flipdict):
        
    #create matrix 
    matrix = []       
    for key in flipdict:
        matrix.append(list(set(flipdict[key])))
        keylist.append(key)
    return matrix

#def generate_cproduct(matrix):
#    #cartesian product
#    product = []
#    for item in itertools.product(*matrix):
#        product.append(item)
#    return product
#
#def get_alt(index, productlist,flipdict):
#    i = int(index)%(len(productlist)) 
#    selection = productlist[i]    
#    rvec = dict()    
#    nkeylist = []
#    for key in flipdict:
#        nkeylist.append(key)
#    for key,value in zip(nkeylist,selection):
#        rvec[key] = value
#    return rvec
#
#def update_model(rvec, node):
#    for input in node.Params.Input:
#        value = rvec[input.NickName]
#        input.Sources[0].Slider.Value = value
#    node.ExpireSolution(True)
#    print "Updated "+node.NickName


# Generate cartesian product from Rhino/GH input 
# and send to gallery on click
#node = get_node(node_name)
flipdict = create_flipdict(data)
matrix = create_matrix(flipdict)
#cproduct = generate_cproduct(matrix)
#_alt = get_alt(index, cproduct, flipdict)
#repeater = get_node("2"+node_name)
#update_model(_alt,repeater)
#alt=json.dumps(_alt)
#_matrix = json.dumps(matrix)
_matrix = matrix
print _matrix
keys = keylist

#cPickle.dumps(keylist)
# ---------- end magicbox ----------
data_grabber = PythonScript(node_name="ReactorGen", path=datafile, record=record, reset=reset)  # inputs record: Boolean
# ---------- data_grabber: Python ----------
import Grasshopper as gh
import os
#path1 = os.path.dirname(path)
#print path1
#path.replace("public\","data.dat")
print path
ghObjects = ghenv.Component.OnPingDocument().Objects
d = dict()
key_list = []
if record:
    for obj in ghObjects:
        if obj.NickName == node_name.ToString():
            value_list = []
            for input in obj.Params.Input:
                if input.Sources[0].NickName:
                    key = input.Sources[0].NickName
                else:
                    input.Sources[0].NickName = input.NickName
                    key = input.Sources[0].NickName
                value = input.Sources[0].Slider.Value.ToDouble(input.Sources[0].Slider.Value)
                d[key] = value
                value_list.append(value)
    if len(d)>0:
#        d_vector = value_list
        print d
        if os.path.exists(path):
            f = open(path,'a')
            f.write(str(d))
            f.write('\n')
        else:
            f = open(path,'w')
            f.write(str(d))
            f.write('\n')
        f.close()
 
if reset:
    f = open(path,'w')
    f.write('')
    f.close()
        
#for obj in ghObjects:
#    if obj.NickName == node_name.ToString():
#        value_list = []
#        for input in obj.Params.Input:
#            key_list.append(input.NickName)
#
#length = int(len(key_list))
# ---------- end data_grabber ----------
flux_4 = FluxProject(project="a9jAyvE70YL3qR5WZ")  # -> Keys, Meta
flow_control_3 = FlowControl({"Once", "Constantly"}, selected="Constantly")
serialize = PythonScript(input=magicbox.keys)  # -> output
# ---------- serialize: Python ----------
import cPickle
output = cPickle.dumps(input)
print output
print(type(output))
# ---------- end serialize ----------
serialize_2 = PythonScript(input="ReactorGen")  # -> output; same code as serialize
serialize_3 = PythonScript(input=magicbox.matrix)  # -> output; same code as serialize
from_flux_2 = FromFlux(
    Keys=flux_4.Keys,
    Mode=flow_control_3,
    keyId="408642bb36ad94d34f040012d21f4c92",
    mode="Constantly",
    Branch0_Path="{0;0;0;0}",
    Branch0_Item0_null_string=False,
    Branch0_Item0_string="""(dp0
VOutputShape-seg
p1
F3.0
sVPointY
p2
F0.59999999999999998
sVAttF(x)
p3
F0.0
sVOutputShape
p4
F1.0
sVPointX
p5
F0.80000000000000004
sVScale
p6
F1.0
sVGridType
p7
F3.0
sVAngle
p8
F0.0
s.""",
    Branch0_Item0_TypeName="Grasshopper.Kernel.Types.GH_String")  # -> Value, Meta
kernel2product = PythonScript(node_name="ReactorGen", dir=getdirectory.dir, full_path=getdirectory.full_path, trigger=new_product)
# ---------- kernel2product: Python ----------
import json
import itertools
import Grasshopper as gh
from System import Guid
from scriptcontext import doc
import os
import time
import Rhino
import rhinoscriptsyntax as rs

gh = Rhino.RhinoApp.GetPlugInObject("Grasshopper")

rs.EnableRedraw(True)

pardir = os.path.abspath(os.path.join(dir, os.pardir))
path = os.path.join(pardir,"gallery"+os.sep)
print path
pardir2 = os.path.abspath(os.path.join(path, os.pardir))
path_kernel = os.path.join(pardir2, "received"+os.path.sep)
print path_kernel
keylist = []
valuelist = []
RhinoDocument = Rhino.RhinoDoc.ActiveDoc
view = RhinoDocument.Views.Find('kernel', False)
print view


#
#def chunks(l, n):
#    """Yield successive n-sized chunks from l."""
#    for i in xrange(0, len(l), n):
#        yield l[i:i+n]
#
def create_flipdict(data):
    veclist = []
    # turn strings into dicts
    for item in data:
        vec = eval(item)
        veclist.append(vec)
    
    flipdict = dict()    
    # get the names of keys to iterate over 
    for vec in veclist:   
        for key in vec:
            flipdict[key] = []
    
    #accumulate
    for key in flipdict:
        for vec in veclist:
            if key in vec:
                flipdict[key].append(vec[key])
    return flipdict                

def create_matrix(flipdict):
        
    #create matrix 
    matrix = []       
    for key in flipdict:
        matrix.append(set(flipdict[key]))
    return matrix

def generate_cproduct(matrix):
    #cartesian product
    product = []
    for item in itertools.product(*matrix):
        product.append(item)
    return product

def get_alt(index, productlist,flipdict):
    i = int(index)%(len(productlist)) 
    selection = productlist[i]    
    rvec = dict()    
    nkeylist = []
    for key in flipdict:
        nkeylist.append(key)
    for key,value in zip(nkeylist,selection):
        rvec[key] = value
    return rvec

def update_model(rvec, node):
    for input in node.Params.Input:
        value = rvec[input.NickName]
        input.Sources[0].Slider.Value = value
    node.ExpireSolution(False)
    print "Updated "+node.NickName
    
def get_node(name):
    ghObjects = ghenv.Component.OnPingDocument().Objects
    for obj in ghObjects:
        if obj.NickName == name:
            return obj
    print "Node not found"
def captureView(uid):
    bmp = view.CaptureToBitmap(False, False, False)
    bmp.Save(path+uid+".bmp")       

def send_to_gallery(data,send):
    if send:
        json_data = dict()
    
        uid = str(Guid.NewGuid())
        json_data['params'] = data
        json_data['uid'] = uid
        json_data['cad_file'] = 'xyz.obj'
        json_data['image'] = uid+'.bmp'
        captureView(uid)
#        bitmap = doc.Views.ActiveView.CaptureToBitmap(True, True, True)
#        bitmap.Save(path+uid+'.bmp')
        with open(path+uid+'.json','w') as outfile:
            json.dump(json_data, outfile, indent=2)
        print "Sent "+uid+" to gallery"       





# Generate cart. prod. from new kernel and slowly send to gallery
node = get_node(node_name)
# Read file
if trigger:
    if os.path.exists(path_kernel+'kernel.json'):
        f = open(path_kernel+'kernel.json','r')
        data = f.read()
        f.close()
        if len(data)>0:
            # parse the data into dict
            kernel = eval(data)
            #erase the file contents to prevent infinite loop
            f = open(path_kernel+'kernel.json','w')
            f.write('')
            f.close()
            
            _matrix = create_matrix(kernel)
            _cproduct = generate_cproduct(_matrix)
            
            #now iterate over _cproduct and update model
            #then wait for 1 sec and take snapshot, send to gall
            for i in range(0,3,1):
                _alt = get_alt(i , _cproduct, kernel)
                update_model(_alt,node)
                time.sleep(1)
                gh.RunSolver(full_path)
                time.sleep(1)
                send_to_gallery(_alt, True)
# ---------- end kernel2product ----------
to_flux_3 = ToFlux(Keys=flux_4.Keys, Value=serialize_3, Mode=flow_control_3, keyId="404722a83a22684e0079a179785efa64", mode="Constantly")
to_flux_4 = ToFlux(Keys=flux_4.Keys, Value=serialize_2, Mode=flow_control_3, keyId="4082566f6a4c3b9b7b26701fdb4b1c3b", mode="Constantly")
to_flux_5 = ToFlux(Keys=flux_4.Keys, Value=serialize, Mode=flow_control_3, keyId="40fc6dc0a9c8f0442f6624b91b6640f1", mode="Constantly")
to_flux_6 = ToFlux(Keys=flux_4.Keys, Value=magicbox.index, Mode=flow_control_3, keyId="40b8bce9d56129e52fe444d295fc9af4", mode="Constantly")
send_to_gallery_2 = PythonScript(alt=from_flux_2.Value, dir=getdirectory.dir, cad_file=getdirectory.full_path, send=send_to_gallery)
# ---------- send_to_gallery_2: Python ----------
from System import Guid
import cPickle
import json
from scriptcontext import doc
import rhinoscriptsyntax as rs
import os
import System.Drawing
import Rhino
pardir = os.path.abspath(os.path.join(dir, os.pardir))
path = os.path.join(pardir,"gallery"+os.sep)
print path
alt = cPickle.loads(alt)
normalized_path = os.path.abspath(cad_file).ToString()
print normalized_path
#_alt = json.loads(alt)
RhinoDocument = Rhino.RhinoDoc.ActiveDoc
view = RhinoDocument.Views.Find('product', False)
print view



def captureView(uid):
    bmp = view.CaptureToBitmap(False, False, False)
    bmp.Save(path+uid+".bmp")

#def rCommonCap(viewportName,scaleFactor):
#    RhinoDocument = Rhino.RhinoDoc.ActiveDoc
#    view = RhinoDocument.Views.Find('product', False)
##    vp = view.ActiveViewport
##    size = System.Drawing.Size(vp.Size.Width*scaleFactor,vp.Size.Height*scaleFactor)
#    capture = view.CaptureToBitmap(True, True, True)
#    return capture

def send_to_gallery(data):
    json_data = dict()

    uid = str(Guid.NewGuid())
    json_data['filepath'] = normalized_path
    json_data['params'] = data
    json_data['uid'] = uid
    json_data['cad_file'] = 'xyz.obj'
    json_data['image'] = uid+'.bmp'   
    captureView(uid)
    with open(path+uid+'.json','w') as outfile:
        json.dump(json_data, outfile, indent=2)
    
#    bitmap = doc.Views.ActiveView.CaptureToBitmap(True, True, True)

    print "Sent "+uid+" to gallery"
    
if send:
    send_to_gallery(alt)
# ---------- end send_to_gallery_2 ----------

# ==== cluster ReactorGen
A = ClusterInput()
A_2 = ClusterInput()
hexgrid = Hexagonal(Plane=PlaneXY(0, 0, 0), Size=8, ExtentX=10, ExtentY=8)  # -> Cells, Points
sqgrid = Square(Plane=PlaneXY(0, 0, 0), Size=10, ExtentX=10, ExtentY=10)  # -> Cells, Points
trigrid = Triangular(Plane=PlaneXY(0, 0, 0), Size=10, ExtentX=20, ExtentY=12)  # -> Cells, Points
radgrid = Radial(Plane=PlaneXY(50, 50, 0), Size=5, ExtentR=10, ExtentP=20)  # -> Cells, Points
pop2d = Populate2D(Region={Plane=PlaneXY(0, 0, 0), Size=Domain2(u=0..100, v=0..100)}, Count=100, Seed=1)
G = ClusterInput()
scaleup = Multiplication(A=A, B=100)
scaleup_2 = Multiplication(A=A_2, B=100)
pt = ConstructPoint(XCoordinate=scaleup, YCoordinate=scaleup_2, ZCoordinate=0)
gridtype = StreamFilter(Gate=G, Stream0=pop2d, Stream1=radgrid.Points, Stream2=trigrid.Points, Stream3=hexgrid.Points, Stream4=sqgrid.Points)
pt_2 = Point(pt)
linept_grid = Line(StartPoint=gridtype, EndPoint=pt_2)
G_2 = ClusterInput()
f_x_chooser = StreamFilter(Gate=G_2, Stream0="x/2", Stream1="x", Stream2="x*sin(x)")
len = Length(Curve=linept_grid)
B = ClusterInput()
eval = Evaluate(F=f_x_chooser, x=len)
scaledown = Division(A=eval, B=B)
A_3 = ClusterInput()
G_3 = ClusterInput()
outputtype = StreamGate(Stream=gridtype, Gate=G_3)  # -> Target0, Target1
S = ClusterInput()
circle = CircleCNR(Center=outputtype.Target0, Normal=Vector(0, 0, 1), Radius=scaledown)
polygon = Polygon(Plane=outputtype.Target1, Radius=scaledown, Segments=S, FilletRadius=0)  # -> Polygon, Length
rotate = Rotate(Geometry=polygon.Polygon, Angle=A_3, Plane=outputtype.Target1)  # -> Geometry, Transform
merge = Merge(Data1=circle, Data2=rotate.Geometry)
R = ClusterOutput(merge)
