# Grasshopper definition hysteresis-remote.ghx (Grasshopper 0.9.76)
# plug-ins: Python Interpreter, Flux

c_script = CSharpScript()  # -> Out, A
geo = Geometry()
flux = FluxProject(project="a9jAyvE70YL3qR5WZ")  # -> Keys, Meta
flow_control = FlowControl({"Once", "Constantly"}, selected="Constantly")
to_flux = ToFlux(Keys=flux.Keys, Value=geo, Mode=flow_control, keyId="40cb7ce2f54c0b988a90e04600d8d638", mode="Constantly")
from_flux = FromFlux(
    Keys=flux.Keys,
    Mode=flow_control,
    keyId="404722a83a22684e0079a179785efa64",
    mode="Constantly",
    Branch0_Path="{0;0;0}",
    Branch0_Item0_null_string=False,
    Branch0_Item0_string="""(lp0
F8.0
aF3.0
a.""",
    Branch0_Item0_TypeName="Grasshopper.Kernel.Types.GH_String",
    Branch0_Item1_null_string=False,
    Branch0_Item1_string="""(lp0
F1.0
a.""",
    Branch0_Item1_TypeName="Grasshopper.Kernel.Types.GH_String",
    Branch0_Item2_null_string=False,
    Branch0_Item2_string="""(lp0
F0.0
a.""",
    Branch0_Item2_TypeName="Grasshopper.Kernel.Types.GH_String",
    Branch0_Item3_null_string=False,
    Branch0_Item3_string="""(lp0
F1.0
a.""",
    Branch0_Item3_TypeName="Grasshopper.Kernel.Types.GH_String",
    Branch0_Item4_null_string=False,
    Branch0_Item4_string="""(lp0
F0.90000000000000002
a.""",
    Branch0_Item4_TypeName="Grasshopper.Kernel.Types.GH_String",
    Branch0_Item5_null_string=False,
    Branch0_Item5_string="""(lp0
F6.0
a.""",
    Branch0_Item5_TypeName="Grasshopper.Kernel.Types.GH_String",
    Branch0_Item6_null_string=False,
    Branch0_Item6_string="""(lp0
F1.0
a.""",
    Branch0_Item6_TypeName="Grasshopper.Kernel.Types.GH_String",
    Branch0_Item7_null_string=False,
    Branch0_Item7_string="""(lp0
F8.0
a.""",
    Branch0_Item7_TypeName="Grasshopper.Kernel.Types.GH_String")  # -> Value, Meta
from_flux_2 = FromFlux(
    Keys=flux.Keys,
    Mode=flow_control,
    keyId="40fc6dc0a9c8f0442f6624b91b6640f1",
    mode="Constantly",
    Branch0_Path="{0;0;0}",
    Branch0_Item0_null_string=False,
    Branch0_Item0_string="""VOutputShape-seg
p0
.""",
    Branch0_Item0_TypeName="Grasshopper.Kernel.Types.GH_String",
    Branch0_Item1_null_string=False,
    Branch0_Item1_string="""VPointY
p0
.""",
    Branch0_Item1_TypeName="Grasshopper.Kernel.Types.GH_String",
    Branch0_Item2_null_string=False,
    Branch0_Item2_string="""VAttF(x)
p0
.""",
    Branch0_Item2_TypeName="Grasshopper.Kernel.Types.GH_String",
    Branch0_Item3_null_string=False,
    Branch0_Item3_string="""VOutputShape
p0
.""",
    Branch0_Item3_TypeName="Grasshopper.Kernel.Types.GH_String",
    Branch0_Item4_null_string=False,
    Branch0_Item4_string="""VPointX
p0
.""",
    Branch0_Item4_TypeName="Grasshopper.Kernel.Types.GH_String",
    Branch0_Item5_null_string=False,
    Branch0_Item5_string="""VScale
p0
.""",
    Branch0_Item5_TypeName="Grasshopper.Kernel.Types.GH_String",
    Branch0_Item6_null_string=False,
    Branch0_Item6_string="""VGridType
p0
.""",
    Branch0_Item6_TypeName="Grasshopper.Kernel.Types.GH_String",
    Branch0_Item7_null_string=False,
    Branch0_Item7_string="""VAngle
p0
.""",
    Branch0_Item7_TypeName="Grasshopper.Kernel.Types.GH_String")  # -> Value, Meta
from_flux_3 = FromFlux(
    Keys=flux.Keys,
    Mode=flow_control,
    keyId="4082566f6a4c3b9b7b26701fdb4b1c3b",
    mode="Constantly",
    Branch0_Path="{0}",
    Branch0_Item0_null_string=False,
    Branch0_Item0_string="""VReactorGen
p0
.""",
    Branch0_Item0_TypeName="Grasshopper.Kernel.Types.GH_String")  # -> Value, Meta
from_flux_4 = FromFlux(
    Keys=flux.Keys,
    Mode=flow_control,
    keyId="40b8bce9d56129e52fe444d295fc9af4",
    mode="Constantly",
    Branch0_Path="{0;0}",
    Branch0_Item0_number=28,
    Branch0_Item0_TypeName="Grasshopper.Kernel.Types.GH_Integer")  # -> Value, Meta
deserialize = PythonScript(input=from_flux.Value)  # -> output
# ---------- deserialize: Python ----------
import cPickle
output = cPickle.loads(input)
print output
print(type(output))
# ---------- end deserialize ----------
deserialize_2 = PythonScript(input=from_flux_2.Value)  # -> output; same code as deserialize
deserialize_3 = PythonScript(input=from_flux_3.Value)  # -> output; same code as deserialize
panel = Panel(from_flux_3.Value)
tree2list = PythonScript(intree=deserialize)  # -> outlist; inputs intree: tree
# ---------- tree2list: Python ----------
myList=[]
for i in range(intree.BranchCount):
    arr1 = []
    for j in range(len(intree.Branch(i))):
        arr1.append(intree.Branch(i)[j])
    myList.append(arr1)
    
outlist = myList
print outlist
# ---------- end tree2list ----------
cartesianproduct = PythonScript(kernel=tree2list)  # -> cproduct; inputs kernel: list
# ---------- cartesianproduct: Python ----------
import itertools
import cPickle

def generate_cproduct(matrix):
    #cartesian product
    product = []
    for item in itertools.product(*matrix):
        product.append(item)
    return product

cproduct = generate_cproduct(kernel)
print kernel
# ---------- end cartesianproduct ----------
selector = PythonScript(input=cartesianproduct, keys=deserialize_2, index=from_flux_4.Value, node_name=deserialize_3)  # -> out, a; inputs input: list, keys: list
# ---------- selector: Python ----------
def get_alt(index, productlist,keys):
    i = int(index)%(len(productlist)) 
    selection = productlist[i]    
    rvec = dict()    
    nkeylist = []
    for key in keys:
        nkeylist.append(key)
    for key,value in zip(nkeylist,selection):
        rvec[key] = value
    return rvec

def update_model(rvec, node):
    for input in node.Params.Input:
        value = rvec[input.NickName]
        input.Sources[0].Slider.Value = value
    node.ExpireSolution(True)
    print "Updated "+node.NickName
    
def get_node(name):
    ghObjects = ghenv.Component.OnPingDocument().Objects
    for obj in ghObjects:
        if obj.NickName == name:
            return obj
    print "Node not found"
    
node = get_node(node_name)
_alt = get_alt(index, input, keys)
print _alt
update_model(_alt, node)
# ---------- end selector ----------
